% Simulink data dictionary MotorControl_data.sldd

FOCCmds_BUS = Simulink.Bus()
  VPhase: double[1 3], Unit="V"  % Phase Voltages

FOCInputs_BUS = Simulink.Bus()
  TMotorTorque: double, Unit="Nm"  % Motor Output Torque
  wRotorSpd: double, Unit="rad/s"  % Rotor Speed
  IPhase: double[3], Unit="A"  % Phase Currents
  aRotorMechPos: double, Unit="rad"  % Rotor Mechanical Angle

tSimMoCo = Simulink.Parameter(0.001, DataType="double", Unit="s")  % Simulation Step Time for Motor Control model
NPoles = Simulink.Parameter(4, DataType="single")  % Number of Poles
Rs = Simulink.Parameter(0.02, DataType="double", Unit="Ω")  % Stator Resistance Per Phase
PMFluxLinkage = Simulink.Parameter(0.0725, DataType="double", Unit="Wb")  % Permanent Magnet Flux Linkage
Ld = Simulink.Parameter(6.131386e-05, DataType="double", Unit="H")  % Stator d-axis Inductance
Lq = Simulink.Parameter(0.0001226277, DataType="double", Unit="H")  % Stator q-axis Inductance
w_eff_bp = Simulink.Parameter([-1675 -837.5 0 837.5 1675], DataType="single")  % Vector of Speeds for Tabulated Losses
TMotorMax = Simulink.Parameter(450, Unit="Nm")  % Maximum Motor Torque
ploss_table = Simulink.Parameter(repmat(0.98, 5, 5), DataType="double")  % Power Loss Table
IMotorMax = Simulink.Parameter(150, Unit="A")  % Maximum Motor Current